# Grasshopper definition FloatingTest.gh (Grasshopper 1.0.7)
# plug-ins: Kangaroo2 Components, Kangaroo Components

mesh = Mesh(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)
deconstruct_mesh = DeconstructMesh(Mesh=mesh)  # -> Vertices, Faces, Colours, Normals
nakedvertices = NakedVertices(Mesh=mesh)  # -> ClothedIndex, NakedIndex, ClothedPts, NakedPts
show = Show(G=mesh)
edgelengths = EdgeLengths(Mesh=mesh, LengthFactor=1, Strength=1)
number_slider = Slider(100, range=0..100)

list_length = ListLength(List=deconstruct_mesh.Vertices)
number_slider_2 = Slider(10, range=0..10)
construct_domain = ConstructDomain(DomainStart=0, DomainEnd=list_length)
random = Random(Range=construct_domain, Number=number_slider_2, Seed=2)
construct_domain_2 = ConstructDomain(DomainStart=Slider(7.4, range=0..100), DomainEnd=Slider(20, range=0..100))
integer = Integer(random)
create_set = CreateSet(List=integer)  # -> Set, Map
list_item = ListItem(List=deconstruct_mesh.Vertices, Index=create_set.Set, Wrap=True)
random_2 = Random(Range=construct_domain_2, Number=number_slider_2, Seed=2)
unit_z = UnitZ(Factor=1)
point = Point(list_item)
panel = Panel("浮力")
load = Load(Point=graft(point), ForceVector=unit_z, Weighting=graft(random_2))

point_2 = Point(deconstruct_mesh.Vertices)
unit_z_2 = UnitZ(Factor=1)
negative = Negative(Value=unit_z_2)
panel_2 = Panel("重力")
load_2 = Load(Point=point_2, ForceVector=negative, Weighting=Slider(0.1, range=0..10))

point_3 = Point(nakedvertices.NakedPts)
negative_2 = Negative(Value=number_slider)
unit_z_3 = UnitZ(Factor=negative_2)
unit_z_4 = UnitZ(Factor=number_slider)
move = Move(Geometry=point_3, Motion=unit_z_3)  # -> Geometry, Transform
move_2 = Move(Geometry=point_3, Motion=unit_z_4)  # -> Geometry, Transform
point_4 = Point(point_3)
line = Line(StartPoint=move.Geometry, EndPoint=move_2.Geometry)
oncurve = OnCurve(Points=graft(point_4), Curve=graft(line), Strength=Slider(44, range=0..100))
entwine = Entwine(Branch00=show, Branch01=edgelengths, Branch02=load_2, Branch03=load, Branch04=oncurve, FlattenInputs=True)
solver = Solver(GoalObjects=entwine, Reset=Button(), Threshold=1e-15, Tolerance=0.01, On=Toggle(True))  # -> I, V, O
explode_tree = ExplodeTree(Data=solver.O)  # -> Branch0, Branch1, Branch2
mesh_2 = Mesh(explode_tree.Branch0)
deconstruct_mesh_2 = DeconstructMesh(Mesh=mesh_2)  # -> Vertices, Faces, Colours, Normals
number = Number(random_2)
unit_z_5 = UnitZ(Factor=Slider(20, range=0..20))
construct_domain_3 = ConstructDomain(DomainStart=Slider(2, range=0..10), DomainEnd=Slider(4, range=0..10))
bounds = Bounds(Numbers=number)
list_item_2 = ListItem(List=deconstruct_mesh_2.Vertices, Index=create_set.Set, Wrap=True)
move_3 = Move(Geometry=list_item_2, Motion=unit_z_5)  # -> Geometry, Transform
remap_numbers = RemapNumbers(Value=number, Source=bounds, Target=construct_domain_3)  # -> Mapped, Clipped
mesh_edges = MeshEdges(Mesh=mesh_2)  # -> NakedEdges, InteriorEdges, NonManifoldEdges
line_2 = Line(StartPoint=list_item_2, EndPoint=move_3.Geometry)
mesh_sphere = MeshSphere(Base=move_3.Geometry, Radius=remap_numbers.Mapped, UCount=10, VCount=20)
