# Grasshopper definition 十字构件布料收缩.gh (Grasshopper 1.0.7)
# plug-ins: Kangaroo Components, Kangaroo2 Components, Weaverbird

curve = Curve([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])
curve_middle = CurveMiddle(Curve=curve)
curve_2 = Curve(curve)
length = Length(Curve=curve_2)
average = Average(Input=curve_middle)
panel = Panel(length)
pi = Pi(Factor=Slider(0.01, range=0..0.1))
yz_plane = YZPlane(Origin=average)
rotate = Rotate(Geometry=curve, Angle=pi, Plane=yz_plane)  # -> Geometry, Transform
curve_3 = Curve(rotate.Geometry)
end_points = EndPoints(Curve=curve_3)  # -> Start, End
removeduplicatepts = RemoveDuplicatePts(Points=[end_points.Start, end_points.End], Tolerance=0.01)
delaunay_mesh = DelaunayMesh(Points=removeduplicatepts, Plane=PlaneXY(0, 0, 0))
mesh_edges = MeshEdges(Mesh=delaunay_mesh)  # -> NakedEdges, InteriorEdges, NonManifoldEdges
weaverbird_s_split_triangles_subdivision = WeaverbirdsSplitTrianglesSubdivision(MeshCurves=delaunay_mesh, Level=Slider(4, range=0..10))
mesh = Mesh(weaverbird_s_split_triangles_subdivision)
point = Point([<point referenced from the Rhino model> x4])
point_2 = Point(point)

length_2 = Length(Curve=curve_3)
number_slider = Slider(1000, range=0..1000)
panel_2 = Panel("保持原始长度")
multiplication = Multiplication(A=length_2, B=Slider(1, range=0..1))
length_line = LengthLine(Line=curve_3, Length=multiplication, Strength=Slider(10000, range=0..10000))

number_slider_2 = Slider(10000, range=0..10000)
average_2 = Average(Input=point_2)
show = Show(G=curve_3)
show_2 = Show(G=mesh)
edgelengths = EdgeLengths(Mesh=mesh, LengthFactor=Slider(0.23, range=0..1), Strength=Slider(500, range=0..1000))
rod = Rod(
    Polyline=curve_3,
    LengthFactor=Slider(1, range=0..1),
    AngleFactor=1,
    AxialStrength=Slider(1000, range=0..1000),
    BendStrength=Slider(10000, range=0..10000))
floor = Floor(Strength=Slider(0.1, range=0..0.1))
scale = Scale(Geometry=point_2, Center=average_2, Factor=Slider(1, range=0..1))  # -> Geometry, Transform
anchorxyz = AnchorXYZ(Point=point_2, X=False, Y=True, Z=True, Strength=number_slider_2)
anchor = Anchor(Point=point_2, Target=scale.Geometry, Strength=number_slider_2)
entwine = Entwine(
    Branch00=show_2,
    Branch01=show,
    Branch02=rod,
    Branch03=edgelengths,
    Branch04=floor,
    Branch07=length_line,
    FlattenInputs=True)
solver = Solver(GoalObjects=flatten(entwine), Reset=Button(), Threshold=1e-15, Tolerance=0.01, On=Toggle(False))  # -> I, V, O
unflatten_tree = UnflattenTree(Tree=solver.O, Guide=entwine)  # -> simplify(Tree)
explode_tree = ExplodeTree(Data=unflatten_tree)  # -> Branch0, Branch1, Branch2, Branch3, Branch4, Branch5, Branch6, Branch7
mesh_2 = Mesh(explode_tree.Branch0)
curve_4 = Curve(explode_tree.Branch1)
colour_swatch = ColourSwatch(SwatchColor=RGB(191, 191, 191))
pipe = Pipe(Curve=curve_4, Radius=Slider(0.1, range=0..0.1), Caps=0)
curve_5 = Curve(curve_4)
length_3 = Length(Curve=curve_5)
custom_preview = CustomPreview(Geometry=pipe, Material=ColourSwatch(SwatchColor=RGB(255, 0, 0)))
panel_3 = Panel(length_3)
